% Simulink design studies windMultiSim.mldatx for model SimulationLoop

study "DesignStudy": 100 simulations
  combinatorial set (100 points):
    "Block Parameter_1": BlockParameter(BlockPath=SimulationLoop/Plant Simulation/Disturbance Models and Integrator/Wind/Wind Gain, Name=Gain), values wblrnd(0.6, 2, 1, 100) (100 points)